# Grasshopper definition TowMi.gh (Grasshopper 1.0.8)

floor_to_floor_high = Slider(600, range=300..600)
base_plinth_number_of_floors = Slider(2, range=1..5)
base_plinth_width = Slider(2500, range=0..10000)
base_plinth_length = Slider(2500, range=0..10000)
degree_rotation = Slider(0, range=0..90)
orientation = Slider(0, range=0..100)
pt = Point(<point referenced from the Rhino model>)
plint_geometry = PlintGeometry(
    P=pt,
    A_2=base_plinth_width,
    B_2=base_plinth_width,
    A=base_plinth_length,
    B=base_plinth_length,
    S=floor_to_floor_high,
    N=floor_to_floor_high,
    Panel=floor_to_floor_high,
    C=base_plinth_number_of_floors,
    S_2=orientation,
    N_2=degree_rotation,
    C_2=base_plinth_number_of_floors)
point_finder = PointFinder(L=plint_geometry)
pt_2 = Point(point_finder)
first_section_length = Slider(2000, range=0..10000)
first_section_width = Slider(2000, range=0..10000)
first_section_length_2 = Slider(1600, range=0..10000)
first_section_width_2 = Slider(1600, range=0..10000)
first_section_number_of_floors = Slider(10, range=1..50)
floor_to_floor_high_2 = Slider(600, range=300..600)
dom = ConstructDomain(DomainStart=expr("x*-1", first_section_length), DomainEnd=first_section_length)
dom_2 = ConstructDomain(DomainStart=expr("x*-1", first_section_width), DomainEnd=first_section_width)
degree_of_rotation = Slider(90, range=0..90)
floor_to_floor_high_3 = Slider(400, range=300..600)
courtyard_number_of_floors = Slider(2, range=1..4)
dom_3 = ConstructDomain(DomainStart=expr("x*-1", first_section_length_2), DomainEnd=first_section_length_2)
dom_4 = ConstructDomain(DomainStart=expr("x*-1", first_section_width_2), DomainEnd=first_section_width_2)
rectangle = Rectangle(Plane=pt_2, XSize=dom_2, YSize=dom, Radius=0)  # -> Rectangle, Length
first_section_length_3 = Slider(3824, range=100..8000)
first_section_width_3 = Slider(3099, range=100..8000)
number_slider = Slider(1687, range=0..10000)
number_slider_2 = Slider(2000, range=0..10000)
area = Area(Geometry=rectangle.Rectangle)  # -> Area, Centroid
series = Series(Start=0, Step=floor_to_floor_high_2, Count=first_section_number_of_floors)
series_2 = Series(Start=Slider(0, range=0..100), Step=degree_of_rotation, Count=first_section_number_of_floors)
series_3 = Series(Start=0, Step=floor_to_floor_high_3, Count=courtyard_number_of_floors)
series_4 = Series(Start=Slider(0, range=0..100), Step=Slider(0, range=0..90), Count=courtyard_number_of_floors)
second_section_number_of_floors = Slider(12, range=1..50)
panel = Panel(series_2)
floor_to_floor_high_4 = Slider(600, range=300..600)
dom_5 = ConstructDomain(DomainStart=expr("x*-1", number_slider), DomainEnd=number_slider)
dom_6 = ConstructDomain(DomainStart=expr("x*-1", number_slider_2), DomainEnd=number_slider_2)
panel_2 = Panel(series_4)
panel_3 = Panel(series)
rad = Radians(Degrees=panel)
panel_4 = Panel(series_3)
rad_2 = Radians(Degrees=panel_2)
rad_3 = Radians(Degrees=Slider(0, range=0..180))
panel_5 = Panel(rad)
rad_4 = Radians(Degrees=Slider(0, range=0..180))
panel_6 = Panel(rad_2)
rotate = Rotate(Geometry=rectangle.Rectangle, Angle=rad_3, Plane=area.Centroid)  # -> Geometry, Transform
Z = UnitZ(Factor=panel_3)
series_5 = Series(Start=0, Step=floor_to_floor_high_4, Count=second_section_number_of_floors)
series_6 = Series(Start=Slider(0, range=0..100), Step=Slider(90, range=0..90), Count=second_section_number_of_floors)
Z_2 = UnitZ(Factor=panel_4)
read_last = Slider(-1, range=-1..0)
move = Move(Geometry=rotate.Geometry, Motion=Z)  # -> Geometry, Transform
panel_7 = Panel(series_6)
read_last_2 = Slider(-1, range=-1..0)
rad_5 = Radians(Degrees=panel_7)
panel_8 = Panel(series_5)
rotate_2 = Rotate(Geometry=move.Geometry, Angle=panel_5, Plane=area.Centroid)  # -> Geometry, Transform
panel_9 = Panel(floor_to_floor_high_2)
item = ListItem(List=panel_3, Index=read_last, Wrap=True)
rad_6 = Radians(Degrees=Slider(0, range=0..180))
panel_10 = Panel(rad_5)
panel_11 = Panel(floor_to_floor_high_3)
panel_12 = Panel(item)
item_2 = ListItem(List=panel_4, Index=read_last_2, Wrap=True)
last_item = Slider(-1, range=-1..0)
Z_3 = UnitZ(Factor=panel_11)
Z_4 = UnitZ(Factor=panel_8)
panel_13 = Panel(item_2)
last_item_2 = Slider(-1, range=-1..0)
read_last_3 = Slider(-1, range=-1..0)
last_item_3 = Slider(-1, range=-1..0)
Z_5 = UnitZ(Factor=panel_9)
boundary = BoundarySurfaces(Edges=rotate_2.Geometry)
last_item_4 = Slider(-1, range=-1..0)
panel_14 = Panel(floor_to_floor_high_4)
item_3 = ListItem(List=panel_8, Index=read_last_3, Wrap=True)
extr = Extrude(Base=boundary, Direction=Z_5)
item_4 = ListItem(List=extr, Index=last_item, Wrap=True)
debrep = DeconstructBrep(Brep=item_4)  # -> Faces, Edges, Vertices
item_5 = ListItem(List=debrep.Faces, Index=last_item_3, Wrap=True)
Z_6 = UnitZ(Factor=panel_14)
panel_15 = Panel(item_3)
area_2 = Area(Geometry=item_5)  # -> Area, Centroid
pt_3 = Point(area_2.Centroid)
rectangle_2 = Rectangle(Plane=pt_3, XSize=dom_4, YSize=dom_3, Radius=0)  # -> Rectangle, Length
area_3 = Area(Geometry=rectangle_2.Rectangle)  # -> Area, Centroid
rotate_3 = Rotate(Geometry=rectangle_2.Rectangle, Angle=rad_4, Plane=area_3.Centroid)  # -> Geometry, Transform
move_2 = Move(Geometry=rotate_3.Geometry, Motion=Z_2)  # -> Geometry, Transform
rotate_4 = Rotate(Geometry=move_2.Geometry, Angle=panel_6, Plane=area_3.Centroid)  # -> Geometry, Transform
boundary_2 = BoundarySurfaces(Edges=rotate_4.Geometry)
extr_2 = Extrude(Base=boundary_2, Direction=Z_3)
item_6 = ListItem(List=extr_2, Index=last_item_2, Wrap=True)
debrep_2 = DeconstructBrep(Brep=item_6)  # -> Faces, Edges, Vertices
item_7 = ListItem(List=debrep_2.Faces, Index=last_item_4, Wrap=True)
area_4 = Area(Geometry=item_7)  # -> Area, Centroid
pt_4 = Point(area_4.Centroid)
rectangle_3 = Rectangle(Plane=pt_4, XSize=dom_6, YSize=dom_5, Radius=0)  # -> Rectangle, Length
area_5 = Area(Geometry=rectangle_3.Rectangle)  # -> Area, Centroid
rotate_5 = Rotate(Geometry=rectangle_3.Rectangle, Angle=rad_6, Plane=area_5.Centroid)  # -> Geometry, Transform
move_3 = Move(Geometry=rotate_5.Geometry, Motion=Z_4)  # -> Geometry, Transform
explode = Explode(Curve=rotate_2.Geometry, Recursive=True)  # -> Segments, Vertices
item_8 = ListItem(List=explode.Segments, Index="0", Wrap=True)  # -> flatten(Item)
rotate_6 = Rotate(Geometry=move_3.Geometry, Angle=panel_10, Plane=area_5.Centroid)  # -> Geometry, Transform
item_9 = ListItem(List=explode.Segments, Index="1", Wrap=True)  # -> flatten(Item)
item_10 = ListItem(List=explode.Segments, Index="2", Wrap=True)  # -> flatten(Item)
item_11 = ListItem(List=explode.Segments, Index="3", Wrap=True)  # -> flatten(Item)
explode_2 = Explode(Curve=rotate_6.Geometry, Recursive=True)  # -> Segments, Vertices

seed = Slider(35, range=0..100)
phi_randomizer = PhiRandomizer(u=seed)
panel_16 = Panel(phi_randomizer)

seed_2 = Slider(63, range=0..100)
phi_randomizer_2 = PhiRandomizer(u=seed_2)
panel_17 = Panel(phi_randomizer_2)

panel_18 = Panel(item_8)
lng = ListLength(List=item_8)

seed_3 = Slider(55, range=0..100)
phi_randomizer_3 = PhiRandomizer(u=seed_3)
panel_19 = Panel(phi_randomizer_3)

seed_4 = Slider(29, range=0..100)
phi_randomizer_4 = PhiRandomizer(u=seed_4)
panel_20 = Panel(phi_randomizer_4)

panel_21 = Panel(lng)
item_12 = ListItem(List=explode_2.Segments, Index="0", Wrap=True)  # -> flatten(Item)
panel_22 = Panel(Z_6)
item_13 = ListItem(List=explode_2.Segments, Index="1", Wrap=True)  # -> flatten(Item)
item_14 = ListItem(List=explode_2.Segments, Index="2", Wrap=True)  # -> flatten(Item)
item_15 = ListItem(List=explode_2.Segments, Index="3", Wrap=True)  # -> flatten(Item)

seed_5 = Slider(16, range=0..100)
phi_randomizer_5 = PhiRandomizer(u=seed_5)
panel_23 = Panel(phi_randomizer_5)

seed_6 = Slider(43, range=0..100)
phi_randomizer_6 = PhiRandomizer(u=seed_6)
panel_24 = Panel(phi_randomizer_6)

panel_25 = Panel(item_12)
lng_2 = ListLength(List=item_12)

seed_7 = Slider(55, range=0..100)
phi_randomizer_7 = PhiRandomizer(u=seed_7)
panel_26 = Panel(phi_randomizer_7)

seed_8 = Slider(28, range=0..100)
phi_randomizer_8 = PhiRandomizer(u=seed_8)
panel_27 = Panel(phi_randomizer_8)

offset = OffsetCurve(Curve=item_9, Distance=panel_16, Corners=1)
offset_2 = OffsetCurve(Curve=item_10, Distance=panel_19, Corners=1)
panel_28 = Panel(lng_2)
offset_3 = OffsetCurve(Curve=item_8, Distance=panel_17, Corners=1)
explode_3 = Explode(Curve=flatten(offset), Recursive=True)  # -> Segments, Vertices
explode_4 = Explode(Curve=flatten(offset_2), Recursive=True)  # -> Segments, Vertices
explode_5 = Explode(Curve=flatten(offset_3), Recursive=True)  # -> Segments, Vertices
explode_6 = Explode(Curve=item_9, Recursive=True)  # -> Segments, Vertices
offset_4 = OffsetCurve(Curve=item_11, Distance=panel_20, Corners=1)
explode_7 = Explode(Curve=item_10, Recursive=True)  # -> Segments, Vertices
explode_8 = Explode(Curve=item_8, Recursive=True)  # -> Segments, Vertices
explode_9 = Explode(Curve=flatten(offset_4), Recursive=True)  # -> Segments, Vertices
explode_10 = Explode(Curve=item_11, Recursive=True)  # -> Segments, Vertices
ln = Line(StartPoint=explode_4.Vertices, EndPoint=explode_7.Vertices)
ln_2 = Line(StartPoint=explode_3.Vertices, EndPoint=explode_6.Vertices)
ln_3 = Line(StartPoint=explode_5.Vertices, EndPoint=explode_8.Vertices)
ln_4 = Line(StartPoint=explode_9.Vertices, EndPoint=explode_10.Vertices)
offset_5 = OffsetCurve(Curve=item_13, Distance=panel_24, Corners=1)
offset_6 = OffsetCurve(Curve=item_14, Distance=panel_26, Corners=1)
merge = Merge(
    Data1=simplify(offset_3),
    Data2=simplify(ln_3),
    Data3=simplify(offset),
    Data4=simplify(ln_2),
    Data5=simplify(offset_2),
    Data6=simplify(ln),
    Data7=simplify(offset_4),
    Data8=simplify(ln_4))
offset_7 = OffsetCurve(Curve=item_12, Distance=panel_23, Corners=1)
explode_11 = Explode(Curve=flatten(offset_5), Recursive=True)  # -> Segments, Vertices
explode_12 = Explode(Curve=flatten(offset_6), Recursive=True)  # -> Segments, Vertices
explode_13 = Explode(Curve=flatten(offset_7), Recursive=True)  # -> Segments, Vertices
explode_14 = Explode(Curve=item_13, Recursive=True)  # -> Segments, Vertices
offset_8 = OffsetCurve(Curve=item_15, Distance=panel_27, Corners=1)
explode_15 = Explode(Curve=item_14, Recursive=True)  # -> Segments, Vertices
explode_16 = Explode(Curve=item_12, Recursive=True)  # -> Segments, Vertices
explode_17 = Explode(Curve=flatten(offset_8), Recursive=True)  # -> Segments, Vertices
explode_18 = Explode(Curve=item_15, Recursive=True)  # -> Segments, Vertices
join = JoinCurves(Curves=merge, Preserve=False)
ln_5 = Line(StartPoint=explode_12.Vertices, EndPoint=explode_15.Vertices)
ln_6 = Line(StartPoint=explode_17.Vertices, EndPoint=explode_18.Vertices)
ln_7 = Line(StartPoint=explode_11.Vertices, EndPoint=explode_14.Vertices)
number_slider_3 = Slider(0, range=0..3)
ln_8 = Line(StartPoint=explode_13.Vertices, EndPoint=explode_16.Vertices)
merge_2 = Merge(
    Data1=simplify(offset_7),
    Data2=simplify(ln_8),
    Data3=simplify(offset_5),
    Data4=simplify(ln_7),
    Data5=simplify(offset_6),
    Data6=simplify(ln_5),
    Data7=simplify(offset_8),
    Data8=simplify(ln_6))
item_16 = ListItem(List=merge, Index=number_slider_3, Wrap=True)
cull_i = CullIndex(List=merge, Indices=number_slider_3, Wrap=True)
shatter = Shatter(Curve=reparameterize(item_16), Parameters=flatten([Slider(0.62, range=0..1), Slider(0.23, range=0..1)]))
join_2 = JoinCurves(Curves=merge_2, Preserve=False)
item_17 = ListItem(List=shatter, Index="1", Wrap=True)
item_18 = ListItem(List=shatter, Index="0", Wrap=True)
item_19 = ListItem(List=shatter, Index="2", Wrap=True)
number_slider_4 = Slider(0, range=0..3)
end = EndPoints(Curve=item_18)  # -> Start, End
end_2 = EndPoints(Curve=item_19)  # -> Start, End
offset_9 = OffsetCurve(Curve=item_17, Distance=expr("x*-1", Slider(1000, range=0..1000)), Corners=1)
end_3 = EndPoints(Curve=offset_9)  # -> Start, End
ln_9 = Line(StartPoint=end.End, EndPoint=end_3.Start)
item_20 = ListItem(List=merge_2, Index=number_slider_4, Wrap=True)
cull_i_2 = CullIndex(List=merge_2, Indices=number_slider_4, Wrap=True)
ln_10 = Line(StartPoint=end_2.Start, EndPoint=end_3.End)
shatter_2 = Shatter(Curve=reparameterize(item_20), Parameters=flatten([Slider(0.43, range=0..1), Slider(0.85, range=0..1)]))
merge_3 = Merge(
    Data1=simplify(cull_i),
    Data2=simplify(ln_9),
    Data3=simplify(item_18),
    Data4=simplify(ln_10),
    Data5=simplify(item_19),
    Data6=simplify(offset_9))
item_21 = ListItem(List=shatter_2, Index="1", Wrap=True)
item_22 = ListItem(List=shatter_2, Index="0", Wrap=True)
item_23 = ListItem(List=shatter_2, Index="2", Wrap=True)
end_4 = EndPoints(Curve=item_22)  # -> Start, End
end_5 = EndPoints(Curve=item_23)  # -> Start, End
offset_10 = OffsetCurve(Curve=item_21, Distance=expr("x*-1", Slider(1000, range=0..1000)), Corners=1)
end_6 = EndPoints(Curve=offset_10)  # -> Start, End
join_3 = JoinCurves(Curves=merge_3, Preserve=False)
ln_11 = Line(StartPoint=end_4.End, EndPoint=end_6.Start)
ln_12 = Line(StartPoint=end_5.Start, EndPoint=end_6.End)
boundary_3 = BoundarySurfaces(Edges=join_3)
merge_4 = Merge(
    Data1=simplify(cull_i_2),
    Data2=simplify(ln_11),
    Data3=simplify(item_22),
    Data4=simplify(ln_12),
    Data5=simplify(item_23),
    Data6=simplify(offset_10))
extr_3 = Extrude(Base=boundary_3, Direction=Z_5)
join_4 = JoinCurves(Curves=merge_4, Preserve=False)
boundary_4 = BoundarySurfaces(Edges=join_4)  # -> flatten(Surfaces)
extr_4 = Extrude(Base=boundary_4, Direction=panel_22)

# ==== cluster PlintGeometry
A = ClusterInput()
B = ClusterInput()
A_2 = ClusterInput()
B_2 = ClusterInput()
dom = ConstructDomain(DomainStart=expr("x*-1", A), DomainEnd=B)
dom_2 = ConstructDomain(DomainStart=expr("x*-1", A_2), DomainEnd=B_2)
P = ClusterInput()
rectangle = Rectangle(Plane=P, XSize=dom_2, YSize=dom, Radius=0)  # -> Rectangle, Length
S = ClusterInput()
N = ClusterInput()
C = ClusterInput()
S_2 = ClusterInput()
N_2 = ClusterInput()
C_2 = ClusterInput()
area = Area(Geometry=rectangle.Rectangle)  # -> Area, Centroid
series = Series(Start=S, Step=N, Count=C)
series_2 = Series(Start=S_2, Step=N_2, Count=C_2)
panel = Panel(series_2)
panel_2 = Panel(series)
rad = Radians(Degrees=panel)
rad_2 = Radians(Degrees=Slider(0, range=0..180))
panel_3 = Panel(rad)
rotate = Rotate(Geometry=rectangle.Rectangle, Angle=rad_2, Plane=area.Centroid)  # -> Geometry, Transform
Z = UnitZ(Factor=panel_2)
move = Move(Geometry=rotate.Geometry, Motion=Z)  # -> Geometry, Transform
read_last = Slider(-1, range=-1..0)
panel_4 = Panel(ClusterInput())
rotate_2 = Rotate(Geometry=move.Geometry, Angle=panel_3, Plane=area.Centroid)  # -> Geometry, Transform
Z_2 = UnitZ(Factor=panel_4)
boundary = BoundarySurfaces(Edges=rotate_2.Geometry)
item = ListItem(List=panel_2, Index=read_last, Wrap=True)
panel_5 = Panel(item)
extr = Extrude(Base=boundary, Direction=Z_2)
E = ClusterOutput(extr)

# ==== cluster PointFinder
L = ClusterInput()
last_item = Slider(-1, range=-1..0)
item = ListItem(List=L, Index=last_item, Wrap=True)
last_item_2 = Slider(-1, range=-1..0)
debrep = DeconstructBrep(Brep=item)  # -> Faces, Edges, Vertices
item_2 = ListItem(List=debrep.Faces, Index=last_item_2, Wrap=True)
area = Area(Geometry=item_2)  # -> Area, Centroid
C = ClusterOutput(area.Centroid)

# ==== cluster PhiRandomizer
min_val = Slider(200, range=0..200)
max_val = Slider(500, range=200..500)
count = Slider(10, range=1..100)
u = ClusterInput()
py3 = Python3Script(z=count, x=min_val, y=max_val, u=u)  # -> out, a
# ---------- py3: Python ----------
import rhinoscriptsyntax as rs
import random
import math

# Define inputs - this is the crucial part that was missing
def get_inputs():
    global z, x, y, u  # These are the default input names in Grasshopper Python component
    return z, x, y, u

# Get the inputs
count, min_val, max_val, seed = get_inputs()

# Golden Ratio
phi = (1 + math.sqrt(5)) / 2

# Set random seed
random.seed(seed)

def golden_sequence(n, min_val, max_val, phi):
    values = []
    seed = random.random()
    
    for i in range(int(n)):  # Convert n to integer
        seed = (seed + phi) % 1
        value = min_val + seed * (max_val - min_val)
        values.append(value)
    
    return values

# Generate values
values = golden_sequence(count, min_val, max_val, phi)

# Output
a = values
# ---------- end py3 ----------
a = ClusterOutput(py3.a)
