# Grasshopper definition TowerMilan.ghx (Grasshopper 1.0.8)

pt = Point(<point referenced from the Rhino model>)
floor_to_floor_high = Slider(600, range=300..600)
base_plinth_number_of_floors = Slider(2, range=1..5)
base_plinth_width = Slider(2500, range=0..10000)
base_plinth_length = Slider(2500, range=0..10000)
degree_rotation = Slider(0, range=0..90)
orientation = Slider(0, range=0..100)
rectangle = Rectangle(Plane=pt, XSize=Slider(3886.668, range=0..10000), YSize=Slider(3581.81, range=0..10000), Radius=0)  # -> Rectangle, Length
pt_2 = Point(<point referenced from the Rhino model>)
plint_geometry = PlintGeometry(
    P=pt_2,
    A_2=base_plinth_width,
    B_2=base_plinth_width,
    A=base_plinth_length,
    B=base_plinth_length,
    S=floor_to_floor_high,
    N=floor_to_floor_high,
    Panel=floor_to_floor_high,
    C=base_plinth_number_of_floors,
    S_2=orientation,
    N_2=degree_rotation,
    C_2=base_plinth_number_of_floors)
point_finder = PointFinder(L=plint_geometry)
area = Area(Geometry=rectangle.Rectangle)  # -> Area, Centroid
pt_3 = Point(point_finder)
first_section_length = Slider(2000, range=0..10000)
first_section_width = Slider(2000, range=0..10000)
rad = Radians(Degrees=Slider(0, range=0..180))
number_slider = Slider(32, range=0..100)
number_slider_2 = Slider(400, range=250..600)
first_section_length_2 = Slider(1600, range=0..10000)
first_section_width_2 = Slider(1600, range=0..10000)
rotate = Rotate(Geometry=rectangle.Rectangle, Angle=rad, Plane=area.Centroid)  # -> Geometry, Transform
first_section_number_of_floors = Slider(10, range=1..50)
floor_to_floor_high_2 = Slider(600, range=300..600)
dom = ConstructDomain(DomainStart=expr("x*-1", first_section_length), DomainEnd=first_section_length)
dom_2 = ConstructDomain(DomainStart=expr("x*-1", first_section_width), DomainEnd=first_section_width)
series = Series(Start=Slider(0, range=0..100), Step=number_slider_2, Count=number_slider)
degree_of_rotation = Slider(90, range=0..90)
floor_to_floor_high_3 = Slider(400, range=300..600)
courtyard_number_of_floors = Slider(2, range=1..4)
dom_3 = ConstructDomain(DomainStart=expr("x*-1", first_section_length_2), DomainEnd=first_section_length_2)
dom_4 = ConstructDomain(DomainStart=expr("x*-1", first_section_width_2), DomainEnd=first_section_width_2)
panel = Panel(series)
rectangle_2 = Rectangle(Plane=pt_3, XSize=dom_2, YSize=dom, Radius=0)  # -> Rectangle, Length
first_section_length_3 = Slider(3824, range=100..8000)
first_section_width_3 = Slider(3099, range=100..8000)
number_slider_3 = Slider(1687, range=0..10000)
number_slider_4 = Slider(2000, range=0..10000)
area_2 = Area(Geometry=rectangle_2.Rectangle)  # -> Area, Centroid
series_2 = Series(Start=0, Step=floor_to_floor_high_2, Count=first_section_number_of_floors)
series_3 = Series(Start=Slider(0, range=0..100), Step=degree_of_rotation, Count=first_section_number_of_floors)
Z = UnitZ(Factor=panel)
series_4 = Series(Start=0, Step=floor_to_floor_high_3, Count=courtyard_number_of_floors)
series_5 = Series(Start=Slider(0, range=0..100), Step=Slider(0, range=0..90), Count=number_slider)
series_6 = Series(Start=Slider(0, range=0..100), Step=Slider(0, range=0..90), Count=courtyard_number_of_floors)
second_section_number_of_floors = Slider(12, range=1..50)
panel_2 = Panel(series_3)
floor_to_floor_high_4 = Slider(600, range=300..600)
panel_3 = Panel(series_5)
dom_5 = ConstructDomain(DomainStart=expr("x*-1", number_slider_3), DomainEnd=number_slider_3)
dom_6 = ConstructDomain(DomainStart=expr("x*-1", number_slider_4), DomainEnd=number_slider_4)
move = Move(Geometry=rotate.Geometry, Motion=Z)  # -> Geometry, Transform
panel_4 = Panel(series_6)
panel_5 = Panel(series_2)
rad_2 = Radians(Degrees=panel_2)
panel_6 = Panel(series_4)
rad_3 = Radians(Degrees=panel_4)
rad_4 = Radians(Degrees=Slider(0, range=0..180))
panel_7 = Panel(rad_2)
rad_5 = Radians(Degrees=panel_3)
rad_6 = Radians(Degrees=Slider(0, range=0..180))
panel_8 = Panel(rad_3)
rotate_2 = Rotate(Geometry=rectangle_2.Rectangle, Angle=rad_4, Plane=area_2.Centroid)  # -> Geometry, Transform
Z_2 = UnitZ(Factor=panel_5)
series_7 = Series(Start=0, Step=floor_to_floor_high_4, Count=second_section_number_of_floors)
rotate_3 = Rotate(Geometry=move.Geometry, Angle=rad_5, Plane=area.Centroid)  # -> Geometry, Transform
series_8 = Series(Start=Slider(0, range=0..100), Step=Slider(90, range=0..90), Count=second_section_number_of_floors)
Z_3 = UnitZ(Factor=panel_6)
read_last = Slider(-1, range=-1..0)
move_2 = Move(Geometry=rotate_2.Geometry, Motion=Z_2)  # -> Geometry, Transform
panel_9 = Panel(series_8)
read_last_2 = Slider(-1, range=-1..0)
Z_4 = UnitZ(Factor=number_slider_2)
rad_7 = Radians(Degrees=panel_9)
boundary = BoundarySurfaces(Edges=move.Geometry)
panel_10 = Panel(series_7)
rotate_4 = Rotate(Geometry=move_2.Geometry, Angle=panel_7, Plane=area_2.Centroid)  # -> Geometry, Transform
panel_11 = Panel(floor_to_floor_high_2)
item = ListItem(List=panel_5, Index=read_last, Wrap=True)
rad_8 = Radians(Degrees=Slider(0, range=0..180))
panel_12 = Panel(rad_7)
larger = LargerThan(FirstNumber=panel_3, SecondNumber=Slider(10, range=0..30))  # -> LargerThan, OrEqualTo
panel_13 = Panel(floor_to_floor_high_3)
panel_14 = Panel(item)
item_2 = ListItem(List=panel_6, Index=read_last_2, Wrap=True)
last_item = Slider(-1, range=-1..0)
Z_5 = UnitZ(Factor=panel_13)
Z_6 = UnitZ(Factor=panel_10)
cull = CullPattern(List=boundary, CullPattern=larger.LargerThan)
panel_15 = Panel(item_2)
extr = Extrude(Base=boundary, Direction=Z_4)
last_item_2 = Slider(-1, range=-1..0)
read_last_3 = Slider(-1, range=-1..0)
last_item_3 = Slider(-1, range=-1..0)
loft = Loft(Curves=cull, Options={Adjust=False, Closed=False, LoftEnds=0, LoftSimp=0, LoftType=0, Rebuild=10, Refit=0.01})
cull_2 = CullPattern(List=extr, CullPattern=invert(larger.LargerThan))
Z_7 = UnitZ(Factor=panel_11)
boundary_2 = BoundarySurfaces(Edges=rotate_4.Geometry)
last_item_4 = Slider(-1, range=-1..0)
panel_16 = Panel(floor_to_floor_high_4)
item_3 = ListItem(List=panel_10, Index=read_last_3, Wrap=True)
extr_2 = Extrude(Base=boundary_2, Direction=Z_7)
item_4 = ListItem(List=extr_2, Index=last_item, Wrap=True)
debrep = DeconstructBrep(Brep=item_4)  # -> Faces, Edges, Vertices
item_5 = ListItem(List=debrep.Faces, Index=last_item_3, Wrap=True)
Z_8 = UnitZ(Factor=panel_16)
panel_17 = Panel(item_3)
area_3 = Area(Geometry=item_5)  # -> Area, Centroid
pt_4 = Point(area_3.Centroid)
rectangle_3 = Rectangle(Plane=pt_4, XSize=dom_4, YSize=dom_3, Radius=0)  # -> Rectangle, Length
area_4 = Area(Geometry=rectangle_3.Rectangle)  # -> Area, Centroid
rotate_5 = Rotate(Geometry=rectangle_3.Rectangle, Angle=rad_6, Plane=area_4.Centroid)  # -> Geometry, Transform
move_3 = Move(Geometry=rotate_5.Geometry, Motion=Z_3)  # -> Geometry, Transform
rotate_6 = Rotate(Geometry=move_3.Geometry, Angle=panel_8, Plane=area_4.Centroid)  # -> Geometry, Transform
boundary_3 = BoundarySurfaces(Edges=rotate_6.Geometry)
extr_3 = Extrude(Base=boundary_3, Direction=Z_5)
item_6 = ListItem(List=extr_3, Index=last_item_2, Wrap=True)
debrep_2 = DeconstructBrep(Brep=item_6)  # -> Faces, Edges, Vertices
item_7 = ListItem(List=debrep_2.Faces, Index=last_item_4, Wrap=True)
area_5 = Area(Geometry=item_7)  # -> Area, Centroid
pt_5 = Point(area_5.Centroid)
rectangle_4 = Rectangle(Plane=pt_5, XSize=dom_6, YSize=dom_5, Radius=0)  # -> Rectangle, Length
area_6 = Area(Geometry=rectangle_4.Rectangle)  # -> Area, Centroid
rotate_7 = Rotate(Geometry=rectangle_4.Rectangle, Angle=rad_8, Plane=area_6.Centroid)  # -> Geometry, Transform
move_4 = Move(Geometry=rotate_7.Geometry, Motion=Z_6)  # -> Geometry, Transform
explode = Explode(Curve=rotate_4.Geometry, Recursive=True)  # -> Segments, Vertices
item_8 = ListItem(List=explode.Segments, Index="0", Wrap=True)  # -> flatten(Item)
rotate_8 = Rotate(Geometry=move_4.Geometry, Angle=panel_12, Plane=area_6.Centroid)  # -> Geometry, Transform
item_9 = ListItem(List=explode.Segments, Index="1", Wrap=True)  # -> flatten(Item)
item_10 = ListItem(List=explode.Segments, Index="2", Wrap=True)  # -> flatten(Item)
item_11 = ListItem(List=explode.Segments, Index="3", Wrap=True)  # -> flatten(Item)
explode_2 = Explode(Curve=rotate_8.Geometry, Recursive=True)  # -> Segments, Vertices

seed = Slider(35, range=0..100)
phi_randomizer = PhiRandomizer(u=seed)
panel_18 = Panel(phi_randomizer)

seed_2 = Slider(63, range=0..100)
phi_randomizer_2 = PhiRandomizer(u=seed_2)
panel_19 = Panel(phi_randomizer_2)

panel_20 = Panel(item_8)
lng = ListLength(List=item_8)

seed_3 = Slider(55, range=0..100)
phi_randomizer_3 = PhiRandomizer(u=seed_3)
panel_21 = Panel(phi_randomizer_3)

seed_4 = Slider(29, range=0..100)
phi_randomizer_4 = PhiRandomizer(u=seed_4)
panel_22 = Panel(phi_randomizer_4)

panel_23 = Panel(lng)
item_12 = ListItem(List=explode_2.Segments, Index="0", Wrap=True)  # -> flatten(Item)
panel_24 = Panel(Z_8)
item_13 = ListItem(List=explode_2.Segments, Index="1", Wrap=True)  # -> flatten(Item)
item_14 = ListItem(List=explode_2.Segments, Index="2", Wrap=True)  # -> flatten(Item)
item_15 = ListItem(List=explode_2.Segments, Index="3", Wrap=True)  # -> flatten(Item)

seed_5 = Slider(16, range=0..100)
phi_randomizer_5 = PhiRandomizer(u=seed_5)
panel_25 = Panel(phi_randomizer_5)

seed_6 = Slider(43, range=0..100)
phi_randomizer_6 = PhiRandomizer(u=seed_6)
panel_26 = Panel(phi_randomizer_6)

panel_27 = Panel(item_12)
lng_2 = ListLength(List=item_12)

seed_7 = Slider(55, range=0..100)
phi_randomizer_7 = PhiRandomizer(u=seed_7)
panel_28 = Panel(phi_randomizer_7)

seed_8 = Slider(28, range=0..100)
phi_randomizer_8 = PhiRandomizer(u=seed_8)
panel_29 = Panel(phi_randomizer_8)

offset = OffsetCurve(Curve=item_9, Distance=panel_18, Corners=1)
offset_2 = OffsetCurve(Curve=item_10, Distance=panel_21, Corners=1)
panel_30 = Panel(lng_2)
offset_3 = OffsetCurve(Curve=item_8, Distance=panel_19, Corners=1)
explode_3 = Explode(Curve=flatten(offset), Recursive=True)  # -> Segments, Vertices
explode_4 = Explode(Curve=flatten(offset_2), Recursive=True)  # -> Segments, Vertices
explode_5 = Explode(Curve=flatten(offset_3), Recursive=True)  # -> Segments, Vertices
explode_6 = Explode(Curve=item_9, Recursive=True)  # -> Segments, Vertices
offset_4 = OffsetCurve(Curve=item_11, Distance=panel_22, Corners=1)
explode_7 = Explode(Curve=item_10, Recursive=True)  # -> Segments, Vertices
explode_8 = Explode(Curve=item_8, Recursive=True)  # -> Segments, Vertices
explode_9 = Explode(Curve=flatten(offset_4), Recursive=True)  # -> Segments, Vertices
explode_10 = Explode(Curve=item_11, Recursive=True)  # -> Segments, Vertices
ln = Line(StartPoint=explode_4.Vertices, EndPoint=explode_7.Vertices)
ln_2 = Line(StartPoint=explode_3.Vertices, EndPoint=explode_6.Vertices)
ln_3 = Line(StartPoint=explode_5.Vertices, EndPoint=explode_8.Vertices)
ln_4 = Line(StartPoint=explode_9.Vertices, EndPoint=explode_10.Vertices)
offset_5 = OffsetCurve(Curve=item_13, Distance=panel_26, Corners=1)
offset_6 = OffsetCurve(Curve=item_14, Distance=panel_28, Corners=1)
merge = Merge(
    Data1=simplify(offset_3),
    Data2=simplify(ln_3),
    Data3=simplify(offset),
    Data4=simplify(ln_2),
    Data5=simplify(offset_2),
    Data6=simplify(ln),
    Data7=simplify(offset_4),
    Data8=simplify(ln_4))
offset_7 = OffsetCurve(Curve=item_12, Distance=panel_25, Corners=1)
explode_11 = Explode(Curve=flatten(offset_5), Recursive=True)  # -> Segments, Vertices
explode_12 = Explode(Curve=flatten(offset_6), Recursive=True)  # -> Segments, Vertices
explode_13 = Explode(Curve=flatten(offset_7), Recursive=True)  # -> Segments, Vertices
explode_14 = Explode(Curve=item_13, Recursive=True)  # -> Segments, Vertices
offset_8 = OffsetCurve(Curve=item_15, Distance=panel_29, Corners=1)
explode_15 = Explode(Curve=item_14, Recursive=True)  # -> Segments, Vertices
explode_16 = Explode(Curve=item_12, Recursive=True)  # -> Segments, Vertices
explode_17 = Explode(Curve=flatten(offset_8), Recursive=True)  # -> Segments, Vertices
explode_18 = Explode(Curve=item_15, Recursive=True)  # -> Segments, Vertices
join = JoinCurves(Curves=merge, Preserve=False)
ln_5 = Line(StartPoint=explode_12.Vertices, EndPoint=explode_15.Vertices)
floor_to_floor_high_5 = Slider(600, range=300..600)
second_section_floors = Slider(10, range=0..50)
ln_6 = Line(StartPoint=explode_17.Vertices, EndPoint=explode_18.Vertices)
ln_7 = Line(StartPoint=explode_11.Vertices, EndPoint=explode_14.Vertices)
number_slider_5 = Slider(0, range=0..3)
ln_8 = Line(StartPoint=explode_13.Vertices, EndPoint=explode_16.Vertices)
floor_to_floor_high_6 = Slider(600, range=300..600)
base_plinth_number_of_floors_2 = Slider(2, range=1..10)
merge_2 = Merge(
    Data1=simplify(offset_7),
    Data2=simplify(ln_8),
    Data3=simplify(offset_5),
    Data4=simplify(ln_7),
    Data5=simplify(offset_6),
    Data6=simplify(ln_5),
    Data7=simplify(offset_8),
    Data8=simplify(ln_6))
item_16 = ListItem(List=merge, Index=number_slider_5, Wrap=True)
cull_i = CullIndex(List=merge, Indices=number_slider_5, Wrap=True)
multiplication = Multiplication(A=floor_to_floor_high_5, B=second_section_floors)
shatter = Shatter(Curve=reparameterize(item_16), Parameters=flatten([Slider(0.62, range=0..1), Slider(0.23, range=0..1)]))
multiplication_2 = Multiplication(A=floor_to_floor_high_6, B=base_plinth_number_of_floors_2)
panel_31 = Panel(multiplication)
panel_32 = Panel(multiplication_2)
join_2 = JoinCurves(Curves=merge_2, Preserve=False)
item_17 = ListItem(List=shatter, Index="1", Wrap=True)
item_18 = ListItem(List=shatter, Index="0", Wrap=True)
item_19 = ListItem(List=shatter, Index="2", Wrap=True)
number_slider_6 = Slider(0, range=0..3)
Z_9 = UnitZ(Factor=panel_32)
Z_10 = UnitZ(Factor=panel_31)
end = EndPoints(Curve=item_18)  # -> Start, End
end_2 = EndPoints(Curve=item_19)  # -> Start, End
offset_9 = OffsetCurve(Curve=item_17, Distance=expr("x*-1", Slider(1000, range=0..1000)), Corners=1)
base_plinth_length_2 = Slider(4052, range=100..10000)
second_section_width = Slider(12, range=0..100)
base_plinth_width_2 = Slider(4062, range=100..10000)
end_3 = EndPoints(Curve=offset_9)  # -> Start, End
second_length = Slider(12, range=0..40)
first_section_floors = Slider(10, range=0..50)
floor_to_floor_high_7 = Slider(600, range=300..600)
ln_9 = Line(StartPoint=end.End, EndPoint=end_3.Start)
item_20 = ListItem(List=merge_2, Index=number_slider_6, Wrap=True)
cull_i_2 = CullIndex(List=merge_2, Indices=number_slider_6, Wrap=True)
ln_10 = Line(StartPoint=end_2.Start, EndPoint=end_3.End)
pt_6 = Point(<point referenced from the Rhino model>)
pt_7 = Point(<point referenced from the Rhino model>)
shatter_2 = Shatter(Curve=reparameterize(item_20), Parameters=flatten([Slider(0.43, range=0..1), Slider(0.85, range=0..1)]))
merge_3 = Merge(
    Data1=simplify(cull_i),
    Data2=simplify(ln_9),
    Data3=simplify(item_18),
    Data4=simplify(ln_10),
    Data5=simplify(item_19),
    Data6=simplify(offset_9))
series_9 = Series(Start=0, Step=1, Count=10)
rectangle_5 = Rectangle(Plane=pt_6, XSize=base_plinth_width_2, YSize=base_plinth_length_2, Radius=0)  # -> Rectangle, Length
rectangle_6 = Rectangle(Plane=pt_7, XSize=second_section_width, YSize=second_length, Radius=0)  # -> Rectangle, Length
multiplication_3 = Multiplication(A=floor_to_floor_high_7, B=first_section_floors)
item_21 = ListItem(List=shatter_2, Index="1", Wrap=True)
item_22 = ListItem(List=shatter_2, Index="0", Wrap=True)
panel_33 = Panel(multiplication_3)
item_23 = ListItem(List=shatter_2, Index="2", Wrap=True)
plint = Extrude(Base=rectangle_5.Rectangle, Direction=Z_9)
extr_4 = Extrude(Base=rectangle_6.Rectangle, Direction=Z_10)
end_4 = EndPoints(Curve=item_22)  # -> Start, End
end_5 = EndPoints(Curve=item_23)  # -> Start, End
offset_10 = OffsetCurve(Curve=item_21, Distance=expr("x*-1", Slider(1000, range=0..1000)), Corners=1)
Z_11 = UnitZ(Factor=panel_33)
area_7 = Area(Geometry=plint)  # -> Area, Centroid
courtyard_section_floors = Slider(2, range=1..5)
floor_to_floor_high_8 = Slider(600, range=300..600)
end_6 = EndPoints(Curve=offset_10)  # -> Start, End
first_section_length_4 = Slider(3824, range=100..8000)
first_section_width_4 = Slider(3099, range=100..8000)
join_3 = JoinCurves(Curves=merge_3, Preserve=False)
ln_11 = Line(StartPoint=end_4.End, EndPoint=end_6.Start)
ln_12 = Line(StartPoint=end_5.Start, EndPoint=end_6.End)
pt_8 = Point(area_7.Centroid)
boundary_4 = BoundarySurfaces(Edges=join_3)
merge_4 = Merge(
    Data1=simplify(cull_i_2),
    Data2=simplify(ln_11),
    Data3=simplify(item_22),
    Data4=simplify(ln_12),
    Data5=simplify(item_23),
    Data6=simplify(offset_10))
multiplication_4 = Multiplication(A=floor_to_floor_high_8, B=courtyard_section_floors)
rectangle_7 = Rectangle(Plane=pt_8, XSize=first_section_width_4, YSize=first_section_length_4, Radius=0)  # -> Rectangle, Length
panel_34 = Panel(multiplication_4)
extr_5 = Extrude(Base=boundary_4, Direction=Z_7)
Z_12 = UnitZ(Factor=panel_34)
_1_section = Extrude(Base=rectangle_7.Rectangle, Direction=Z_11)
courtyard_length = Slider(2327, range=100..5000)
area_8 = Area(Geometry=_1_section)  # -> Area, Centroid
courtyard_width = Slider(2226, range=100..5000)
cull_3 = CullPattern(CullPattern=[False, False, True, True])
join_4 = JoinCurves(Curves=merge_4, Preserve=False)
pt_9 = Point(area_8.Centroid)
boundary_5 = BoundarySurfaces(Edges=join_4)  # -> flatten(Surfaces)
rectangle_8 = Rectangle(Plane=pt_9, XSize=courtyard_width, YSize=courtyard_length, Radius=0)  # -> Rectangle, Length
extr_6 = Extrude(Base=boundary_5, Direction=panel_24)
courtyard = Extrude(Base=rectangle_8.Rectangle, Direction=Z_12)

explode_19 = Explode(Recursive=True)  # -> simplify(Segments), Vertices
boundary_6 = BoundarySurfaces()
series_10 = Series(Start="11", Step="1", Count=Slider(5, range=1..20))
series_11 = Series(Start="0", Step="1", Count=Slider(3, range=1..10))
series_12 = Series(Start="6", Step="1", Count=Slider(5, range=1..10))
series_13 = Series(Start="16", Step="1", Count=Slider(5, range=1..12))
panel_35 = Panel(series_10)
panel_36 = Panel(series_11)
panel_37 = Panel(series_12)
panel_38 = Panel(series_13)
item_24 = ListItem(List=explode_19.Segments, Index=panel_37, Wrap=True)
item_25 = ListItem(List=explode_19.Segments, Index=panel_36, Wrap=True)
item_26 = ListItem(List=explode_19.Segments, Index=panel_35, Wrap=True)
item_27 = ListItem(List=explode_19.Segments, Index=panel_38, Wrap=True)
shatter_3 = Shatter(Curve=reparameterize(item_24), Parameters=flatten([Slider(0.58, range=0..1), Slider(0.01, range=0..1)]))
shatter_4 = Shatter(Curve=reparameterize(item_26), Parameters=flatten([Slider(0.18, range=0..1), Slider(0.36, range=0..1)]))
shatter_5 = Shatter(Curve=reparameterize(item_25), Parameters=flatten([Slider(0.53, range=0..1), Slider(0.29, range=0..1)]))
shatter_6 = Shatter(Curve=reparameterize(item_27), Parameters=flatten([Slider(0.45, range=0..1), Slider(0.34, range=0..1)]))
distance_from_facade = Slider(500, range=100..500)
distance_from_facade_2 = Slider(400, range=100..500)
distance_from_facade_3 = Slider(300, range=100..500)
distance_from_facade_4 = Slider(306, range=100..500)
panel_39 = Panel(shatter_5)
item_28 = ListItem(List=shatter_3, Index="1", Wrap=True)
item_29 = ListItem(List=shatter_4, Index="1", Wrap=True)
item_30 = ListItem(List=shatter_6, Index="1", Wrap=True)
item_31 = ListItem(List=shatter_5, Index=0, Wrap=True)
item_32 = ListItem(List=shatter_3, Index="0", Wrap=True)
item_33 = ListItem(List=shatter_3, Index="2", Wrap=True)
item_34 = ListItem(List=shatter_4, Index="0", Wrap=True)
item_35 = ListItem(List=shatter_4, Index="2", Wrap=True)
item_36 = ListItem(List=shatter_6, Index="0", Wrap=True)
item_37 = ListItem(List=shatter_6, Index="2", Wrap=True)
offset_11 = OffsetCurve(Curve=item_28, Distance=expr("x*-1", distance_from_facade), Corners=1)
offset_12 = OffsetCurve(Curve=item_31, Distance=expr("x*-1", distance_from_facade_2), Corners=1)
offset_13 = OffsetCurve(Curve=item_29, Distance=expr("x*-1", distance_from_facade_3), Corners=1)
offset_14 = OffsetCurve(Curve=item_30, Distance=expr("x*-1", distance_from_facade_4), Corners=1)
end_7 = EndPoints(Curve=offset_11)  # -> Start, End
end_8 = EndPoints(Curve=item_33)  # -> Start, End
end_9 = EndPoints(Curve=item_32)  # -> Start, End
end_10 = EndPoints(Curve=offset_13)  # -> Start, End
end_11 = EndPoints(Curve=item_35)  # -> Start, End
end_12 = EndPoints(Curve=item_34)  # -> Start, End
end_13 = EndPoints(Curve=offset_14)  # -> Start, End
end_14 = EndPoints(Curve=item_37)  # -> Start, End
end_15 = EndPoints(Curve=item_36)  # -> Start, End
ln_13 = Line(StartPoint=end_9.End, EndPoint=end_7.Start)
ln_14 = Line(StartPoint=end_8.Start, EndPoint=end_7.End)
ln_15 = Line(StartPoint=end_12.End, EndPoint=end_10.Start)
ln_16 = Line(StartPoint=end_11.Start, EndPoint=end_10.End)
ln_17 = Line(StartPoint=end_15.End, EndPoint=end_13.Start)
ln_18 = Line(StartPoint=end_14.Start, EndPoint=end_13.End)
merge_5 = Merge(Data4=simplify(offset_12))
merge_6 = Merge(
    Data1=simplify(ln_15),
    Data2=simplify(item_34),
    Data3=simplify(ln_16),
    Data4=simplify(offset_13),
    Data5=simplify(item_35))
merge_7 = Merge(
    Data1=simplify(ln_13),
    Data2=simplify(item_32),
    Data3=simplify(ln_14),
    Data4=simplify(offset_11),
    Data5=simplify(item_33))
merge_8 = Merge(
    Data1=simplify(ln_17),
    Data2=simplify(item_36),
    Data3=simplify(ln_18),
    Data4=simplify(offset_14),
    Data5=simplify(item_37))
merge_9 = Merge(Data1=merge_5, Data2=merge_7, Data3=merge_6, Data4=merge_8)
join_5 = JoinCurves(Curves=merge_9, Preserve=False)
boundary_7 = BoundarySurfaces(Edges=join_5)
cull_4 = CullPattern(List=boundary_7, CullPattern=boundary_6)
panel_40 = Panel()
extr_7 = Extrude(Base=cull_4, Direction=panel_40)

explode_20 = Explode(Recursive=True)  # -> Segments, Vertices
item_38 = ListItem(List=explode_20.Segments, Index="3", Wrap=True)  # -> flatten(Item)
item_39 = ListItem(List=explode_20.Segments, Index="0", Wrap=True)  # -> flatten(Item)
item_40 = ListItem(List=explode_20.Segments, Index="1", Wrap=True)  # -> flatten(Item)
item_41 = ListItem(List=explode_20.Segments, Index="2", Wrap=True)  # -> flatten(Item)
lng_3 = ListLength(List=item_39)
dom_7 = ConstructDomain(DomainStart=expr("x/2", Slider(200, range=0..1000)), DomainEnd=expr("x", Slider(288, range=0..1000)))
dom_8 = ConstructDomain(DomainStart=expr("x/2", Slider(0, range=0..1000)), DomainEnd=expr("x", Slider(241, range=0..1000)))
dom_9 = ConstructDomain(DomainStart=expr("x/2", Slider(0, range=0..1000)), DomainEnd=expr("x", Slider(605, range=0..1000)))
random = Random(Range=dom_9, Number=lng_3, Seed=Slider(208, range=0..1000))
dom_10 = ConstructDomain(DomainStart=expr("x/2", Slider(0, range=0..1000)), DomainEnd=expr("x", Slider(312, range=0..1000)))
random_2 = Random(Range=dom_8, Number=lng_3, Seed=Slider(389, range=0..1000))
random_3 = Random(Range=dom_7, Number=lng_3, Seed=Slider(455, range=0..1000))
random_4 = Random(Range=dom_10, Number=lng_3, Seed=Slider(432, range=0..1000))
offset_15 = OffsetCurve(Curve=item_40, Distance=random_3, Corners=1)
offset_16 = OffsetCurve(Curve=item_38, Distance=random, Corners=1)
offset_17 = OffsetCurve(Curve=item_41, Distance=random_2, Corners=1)
offset_18 = OffsetCurve(Curve=item_39, Distance=random_4, Corners=1)
explode_21 = Explode(Curve=flatten(offset_15), Recursive=True)  # -> Segments, Vertices
explode_22 = Explode(Curve=flatten(offset_16), Recursive=True)  # -> Segments, Vertices
explode_23 = Explode(Curve=flatten(offset_17), Recursive=True)  # -> Segments, Vertices
explode_24 = Explode(Curve=flatten(offset_18), Recursive=True)  # -> Segments, Vertices
explode_25 = Explode(Curve=item_40, Recursive=True)  # -> Segments, Vertices
explode_26 = Explode(Curve=item_38, Recursive=True)  # -> Segments, Vertices
explode_27 = Explode(Curve=item_41, Recursive=True)  # -> Segments, Vertices
explode_28 = Explode(Curve=item_39, Recursive=True)  # -> Segments, Vertices
ln_19 = Line(StartPoint=explode_24.Vertices, EndPoint=explode_28.Vertices)
ln_20 = Line(StartPoint=explode_21.Vertices, EndPoint=explode_25.Vertices)
ln_21 = Line(StartPoint=explode_23.Vertices, EndPoint=explode_27.Vertices)
ln_22 = Line(StartPoint=explode_22.Vertices, EndPoint=explode_26.Vertices)
merge_10 = Merge(
    Data1=simplify(offset_18),
    Data2=simplify(ln_19),
    Data3=simplify(offset_15),
    Data4=simplify(ln_20),
    Data5=simplify(offset_17),
    Data6=simplify(ln_21),
    Data7=simplify(offset_16),
    Data8=simplify(ln_22))
number_slider_7 = Slider(6, range=0..10)
join_6 = JoinCurves(Curves=merge_10, Preserve=False)
boundary_8 = BoundarySurfaces(Edges=join_6)  # -> flatten(Surfaces)
item_42 = ListItem(List=merge_10, Index=number_slider_7, Wrap=True)
cull_i_3 = CullIndex(List=merge_10, Indices=number_slider_7, Wrap=True)
shatter_7 = Shatter(Curve=reparameterize(item_42), Parameters=flatten([Slider(0.44, range=0..1), Slider(0.47, range=0..1)]))
item_43 = ListItem(List=shatter_7, Index="1", Wrap=True)
item_44 = ListItem(List=shatter_7, Index="2", Wrap=True)
item_45 = ListItem(List=shatter_7, Index="0", Wrap=True)
offset_19 = OffsetCurve(Curve=item_43, Distance=expr("x*-1", Slider(523, range=0..1000)), Corners=1)
end_16 = EndPoints(Curve=item_45)  # -> Start, End
end_17 = EndPoints(Curve=item_44)  # -> Start, End
end_18 = EndPoints(Curve=offset_19)  # -> Start, End
ln_23 = Line(StartPoint=end_17.Start, EndPoint=end_18.End)
ln_24 = Line(StartPoint=end_16.End, EndPoint=end_18.Start)
merge_11 = Merge(
    Data1=simplify(ln_24),
    Data2=simplify(ln_23),
    Data3=simplify(offset_19),
    Data4=simplify(item_45),
    Data5=simplify(item_44),
    Data6=simplify(cull_i_3))
join_7 = JoinCurves(Curves=merge_11, Preserve=False)
boundary_9 = BoundarySurfaces(Edges=join_7)  # -> flatten(Surfaces)
extr_8 = Extrude(Base=boundary_9)

# ---- group: Phi Randomizer
max_val = Slider(130, range=100..200)
min_val = Slider(17, range=0..100)
count = Slider(5, range=1..10)
seed_9 = Slider(8, range=0..100)
py3 = Python3Script(z=count, x=min_val, y=max_val, u=seed_9)  # -> out, a; same code as py3
panel_41 = Panel(py3.a)

# ---- group: Randomizer
number_slider_8 = Slider(167, range=0..1000)
number_slider_9 = Slider(460, range=0..1000)
lng_4 = ListLength()
dom_11 = ConstructDomain(DomainStart=expr("x/-2", number_slider_8), DomainEnd=expr("x/2", number_slider_8))
random_5 = Random(Range=dom_11, Number=lng_4, Seed=expr("x+1", number_slider_9))
random_6 = Random(Range=dom_11, Number=lng_4, Seed=number_slider_9)

# ----
series_14 = Series(Start="0", Step="1", Count="4")
panel_42 = Panel(series_14)

max_val_2 = Slider(119, range=50..200)
min_val_2 = Slider(6, range=0..50)
count_2 = Slider(3, range=1..100)
seed_10 = Slider(25, range=0..100)
py3_2 = Python3Script(z=count_2, x=min_val_2, y=max_val_2, u=seed_10)  # -> out, a; same code as py3
panel_43 = Panel(py3_2.a)

# ==== cluster PlintGeometry
A = ClusterInput()
B = ClusterInput()
A_2 = ClusterInput()
B_2 = ClusterInput()
dom = ConstructDomain(DomainStart=expr("x*-1", A), DomainEnd=B)
dom_2 = ConstructDomain(DomainStart=expr("x*-1", A_2), DomainEnd=B_2)
P = ClusterInput()
rectangle = Rectangle(Plane=P, XSize=dom_2, YSize=dom, Radius=0)  # -> Rectangle, Length
S = ClusterInput()
N = ClusterInput()
C = ClusterInput()
S_2 = ClusterInput()
N_2 = ClusterInput()
C_2 = ClusterInput()
area = Area(Geometry=rectangle.Rectangle)  # -> Area, Centroid
series = Series(Start=S, Step=N, Count=C)
series_2 = Series(Start=S_2, Step=N_2, Count=C_2)
panel = Panel(series_2)
panel_2 = Panel(series)
rad = Radians(Degrees=panel)
rad_2 = Radians(Degrees=Slider(0, range=0..180))
panel_3 = Panel(rad)
rotate = Rotate(Geometry=rectangle.Rectangle, Angle=rad_2, Plane=area.Centroid)  # -> Geometry, Transform
Z = UnitZ(Factor=panel_2)
move = Move(Geometry=rotate.Geometry, Motion=Z)  # -> Geometry, Transform
read_last = Slider(-1, range=-1..0)
panel_4 = Panel(ClusterInput())
rotate_2 = Rotate(Geometry=move.Geometry, Angle=panel_3, Plane=area.Centroid)  # -> Geometry, Transform
Z_2 = UnitZ(Factor=panel_4)
boundary = BoundarySurfaces(Edges=rotate_2.Geometry)
item = ListItem(List=panel_2, Index=read_last, Wrap=True)
panel_5 = Panel(item)
extr = Extrude(Base=boundary, Direction=Z_2)
E = ClusterOutput(extr)

# ==== cluster PointFinder
L = ClusterInput()
last_item = Slider(-1, range=-1..0)
item = ListItem(List=L, Index=last_item, Wrap=True)
last_item_2 = Slider(-1, range=-1..0)
debrep = DeconstructBrep(Brep=item)  # -> Faces, Edges, Vertices
item_2 = ListItem(List=debrep.Faces, Index=last_item_2, Wrap=True)
area = Area(Geometry=item_2)  # -> Area, Centroid
C = ClusterOutput(area.Centroid)

# ==== cluster PhiRandomizer
min_val = Slider(200, range=0..200)
max_val = Slider(500, range=200..500)
count = Slider(10, range=1..100)
u = ClusterInput()
py3 = Python3Script(z=count, x=min_val, y=max_val, u=u)  # -> out, a
# ---------- py3: Python ----------
import rhinoscriptsyntax as rs
import random
import math

# Define inputs - this is the crucial part that was missing
def get_inputs():
    global z, x, y, u  # These are the default input names in Grasshopper Python component
    return z, x, y, u

# Get the inputs
count, min_val, max_val, seed = get_inputs()

# Golden Ratio
phi = (1 + math.sqrt(5)) / 2

# Set random seed
random.seed(seed)

def golden_sequence(n, min_val, max_val, phi):
    values = []
    seed = random.random()
    
    for i in range(int(n)):  # Convert n to integer
        seed = (seed + phi) % 1
        value = min_val + seed * (max_val - min_val)
        values.append(value)
    
    return values

# Generate values
values = golden_sequence(count, min_val, max_val, phi)

# Output
a = values
# ---------- end py3 ----------
a = ClusterOutput(py3.a)
